# Grasshopper definition ProximityNetworkCurves-GhPlayer.gh (Grasshopper 1.0.7)
# plug-ins: Heteroptera

get_integer = GetInteger(Slider(16, range=0..20), AtLeast=1, AtMost=2147483647, Maximum=2147483647, Minimum=-2147483648, TreeAccess=False)
get_geometry = GetGeometry(AtLeast=0, AtMost=2147483647, DeleteInput=False, Filter=1073741828, TreeAccess=False)
list_item = ListItem(List=get_integer, Index=Slider(-1, range=-1..0), Wrap="True")
end = EndPoints(Curve=get_geometry)  # -> Start, End
network = ProximityNetwork(Points=[end.Start, end.End], Distance=list_item, Number="2")  # -> PointPointTopology, ConnectionPointTopology, Lines
context_bake = ContextBake(Geometry=network.Lines)
