# Grasshopper definition RebuildSurfaceBorder-GhPlayer.gh (Grasshopper 1.0.7)
# Copyright: mrtn.ch

get_geometry = GetGeometry(AtLeast=1, AtMost=1, DeleteInput=True, Filter=1073741832, TreeAccess=False)
edges = BrepEdges(Brep=get_geometry)  # -> Naked, Interior, NonManifold
join = JoinCurves(Curves=edges.Naked, Preserve=False)
simplify = SimplifyCurve(Curve=join, Tolerance=Slider(1000, range=1..1000), AngleTolerance=5)  # -> Curve, Simplified
cpoly = ControlPolygon(Curve=simplify.Curve)  # -> Polygon, Points
boundary = BoundarySurfaces(Edges=cpoly.Polygon)
context_bake = ContextBake(Geometry=boundary)
