# Grasshopper definition cplane harvester.gh (Grasshopper 1.0.7)

c_script = CSharpScript(Update=Button())  # -> out, Planes, Names; inputs Update: Boolean
# ---------- c_script: C# usings ----------
using Rhino.DocObjects;
# ---------- c_script: C# ----------
    List<Plane> planes = new List<Plane>();
    List<string> names = new List<string>();

    foreach (ConstructionPlane cplane in RhinoDocument.NamedConstructionPlanes)
    {
      planes.Add(cplane.Plane);
      names.Add(cplane.Name);
    }

    Planes = planes;
    Names = names;
# ---------- end c_script ----------
panel = Panel(c_script.Names)
tag = TextTag3D(Location=c_script.Planes, Text=c_script.Names, Size=2, Colour=RGB(0, 0, 0), Justification=7)
