# Grasshopper definition diff.gh (Grasshopper 1.0.7)
# plug-ins: SelectablePreview

_3dm = Import3DM(
    File=["G:\4058 Clerkenwell Green\03.00 Current\3.01 3D Model\20220504_BrittonStreet.3dm", "G:\4058 Clerkenwell Green\03.00 Current\3.01 3D Model\20220604_BrittonStreet.3dm"],
    Layer="*",
    Name="*")
branch = TreeBranch(Tree=simplify(_3dm), Path=Slider(1, range=0..10), MaintainPaths=True)
branch_2 = TreeBranch(Tree=simplify(_3dm), Path=Slider(0, range=0..10), MaintainPaths=True)
selpv = SelectablePreview(Geometry=branch, lock=False, maintain=False, order=False)  # -> Geometry, Path, Index
id = Guid(branch)
id_2 = Guid(branch_2)
txt = Text(id_2)
txt_2 = Text(id)
exdiff = SetDifferenceS(SetA=txt, SetB=txt_2)
